# Grasshopper definition WavePavilion_C#.gh (Grasshopper 1.0.7)
# plug-ins: Kangaroo2 Components

number_slider = Slider(30, range=0..50)
subtraction = Subtraction(A=number_slider, B=1)
series = Series(Start=0, Step=Slider(10, range=0..20), Count=number_slider)
range = Range(Domain=Domain(0, 1), Steps=subtraction)
graph_mapper = GraphMapper(
    range,
    x0=0,
    x1=1,
    y0=0,
    y1=1,
    container_name="Bezier",
    cpx=[0, 0.2873941958, 0.7299645543, 1],
    cpy=[0, 1, 0.7993827462, 0.00835031271])
remap_numbers = RemapNumbers(Value=series, Source=Domain(0, 1), Target=graph_mapper)  # -> Mapped, Clipped
construct_point = ConstructPoint(XCoordinate=series, YCoordinate=remap_numbers.Mapped, ZCoordinate=0)

height = Slider(5, range=0..20)
nop = Slider(200, range=0..300)

interpolate = Interpolate(Vertices=construct_point, Degree=3, Periodic=False, KnotStyle=1)  # -> Curve, Length, Domain
height_2 = GetInteger(height, AtLeast=1, AtMost=1, Maximum=2147483647, Minimum=-2147483648, TreeAccess=False)
number_of_panels = GetInteger(nop, AtLeast=1, AtMost=1, Maximum=2147483647, Minimum=-2147483648, TreeAccess=False)
curve = Curve(interpolate.Curve)
unit_z = UnitZ(Factor=height_2)
range_2 = Range(Domain=Domain(0, 1), Steps=number_of_panels)
move = Move(Geometry=curve, Motion=unit_z)  # -> Geometry, Transform
graph_mapper_2 = GraphMapper(
    range_2,
    x0=0,
    x1=1,
    y0=0,
    y1=1,
    container_name="Sine Summation",
    Equation0_px=[0.2, 0.400000006],
    Equation0_py=[0.2, 0.08870965242],
    Equation1_px=[0.6, 0.9969696999],
    Equation1_py=[0.3, 0.4919354916])
entrance_width = GetInteger(Slider(12, range=0..50), AtLeast=1, AtMost=1, Maximum=2147483647, Minimum=-2147483648, TreeAccess=False)
exit_width = GetInteger(Slider(15, range=0..50), AtLeast=1, AtMost=1, Maximum=2147483647, Minimum=-2147483648, TreeAccess=False)
unit_z_2 = UnitZ(Factor=1)
divide_curve = DivideCurve(Curve=move.Geometry, Count=number_of_panels, Kinks=False)  # -> Points, Tangents, Parameters
construct_domain = ConstructDomain(DomainStart=entrance_width, DomainEnd=exit_width)
bounds = Bounds(Numbers=graph_mapper_2)
cross_product = CrossProduct(VectorA=divide_curve.Tangents, VectorB=unit_z_2, Unitize=False)  # -> Vector, Length
remap_numbers_2 = RemapNumbers(Value=graph_mapper_2, Source=bounds, Target=construct_domain)  # -> Mapped, Clipped
reverse = Reverse(Vector=cross_product.Vector)
line_sdl = LineSDL(Start=divide_curve.Points, Direction=cross_product.Vector, Length=remap_numbers_2.Mapped)
line_sdl_2 = LineSDL(Start=divide_curve.Points, Direction=reverse, Length=remap_numbers_2.Mapped)
number = Number(range_2)
join_curves = JoinCurves(Curves=[line_sdl, line_sdl_2], Preserve=False)
graph_mapper_3 = GraphMapper(number, x0=0, x1=1, y0=0, y1=1, container_name="Sine", Equation_px=[0, 0.1484848559], Equation_py=[0, 0.9879032373])
graph_mapper_4 = GraphMapper(number, x0=0, x1=1, y0=0, y1=1, container_name="Gaussian", factor=0.3914770484, mean=0.5, sdev=0.217045188)
construct_domain_2 = ConstructDomain(DomainStart=Slider(9, range=0..50), DomainEnd=Slider(15, range=0..50))
bounds_2 = Bounds(Numbers=graph_mapper_4)
perp_frame = PerpFrame(Curve=reparameterize(join_curves), Parameter="0.5")
evaluate_length = EvaluateLength(Curve=join_curves, Length=graph_mapper_3, Normalized=True)  # -> Point, Tangent, Parameter
remap_numbers_3 = RemapNumbers(Value=graph_mapper_4, Source=bounds_2, Target=construct_domain_2)  # -> Mapped, Clipped
deconstruct_plane = DeconstructPlane(Plane=perp_frame)  # -> Origin, XAxis, YAxis, ZAxis
unit_z_3 = UnitZ(Factor=remap_numbers_3.Mapped)
move_2 = Move(Geometry=evaluate_length.Point, Motion=unit_z_3)  # -> Geometry, Transform
end_points = EndPoints(Curve=join_curves)  # -> Start, End
project = Project(Geometry=end_points.Start, Plane=PlaneXY(0, 0, 0))  # -> Geometry, Transform
project_2 = Project(Geometry=end_points.End, Plane=PlaneXY(0, 0, 0))  # -> Geometry, Transform
unit_z_4 = UnitZ(Factor=1)
merge = Merge(
    Data1=graft(project.Geometry),
    Data2=graft(end_points.Start),
    Data3=graft(move_2.Geometry),
    Data4=graft(end_points.End),
    Data5=graft(project_2.Geometry))
construct_plane = ConstructPlane(Origin=deconstruct_plane.Origin, XAxis=unit_z_4, YAxis=deconstruct_plane.ZAxis)
polyline = PolyLine(Vertices=merge, Closed=False)  # -> flatten(Polyline)
offset_curve = OffsetCurve(Curve=polyline, Distance=Slider(1.2, range=0..2), Plane=construct_plane, Corners=1)  # -> flatten(Curve)
panel_thickness = Slider(0.2, range=0..1)
flip_curve = FlipCurve(Curve=offset_curve)  # -> Curve, Flag
panel_thickness_2 = GetNumber(panel_thickness, AtLeast=1, AtMost=1, Maximum=1.797693135e+308, Minimum=-1.797693135e+308, TreeAccess=False)
merge_2 = Merge(Data1=graft(polyline), Data2=graft(flip_curve.Curve))
connect_curves = ConnectCurves(Curves=merge_2, Continuity=0, Close=True, Bulge=1)  # -> flatten(Curve)
amplitude = Amplitude(Vector=construct_plane, Amplitude=panel_thickness_2)
boundary_surfaces = BoundarySurfaces(Edges=connect_curves)
move_3 = Move(Geometry=boundary_surfaces, Motion=amplitude)  # -> Geometry, Transform
multiplication = Multiplication(A=amplitude, B=Slider(2, range=0..10))
extrude = Extrude(Base=move_3.Geometry, Direction=multiplication)
deconstruct_mesh = DeconstructMesh(Mesh=extrude)  # -> Vertices, Faces, Colours, Normals
mesh_from_subd = MeshFromSubD(SubD=extrude, Density=2)

# ---- group: Geomtery Color
colour_swatch = ColourSwatch(SwatchColor=RGB(218, 91, 36))

# ----
combine_clean = CombineClean(Meshes=mesh_from_subd)
construct_mesh = ConstructMesh(Vertices=deconstruct_mesh.Vertices, Faces=deconstruct_mesh.Faces, Colours=colour_swatch)
mesh_edges = MeshEdges(Mesh=combine_clean)  # -> NakedEdges, InteriorEdges, NonManifoldEdges
combine_clean_2 = CombineClean(Meshes=construct_mesh)
point_on_curve = PointOnCurve(mesh_edges.NakedEdges, parameter=0.5)

# ---- group: RH_OUT: WavePavilion
context_bake = ContextBake(WavePavilion=combine_clean_2)

# ----
construct_point_2 = ConstructPoint(XCoordinate=0, YCoordinate=0, ZCoordinate=0)
curve_2 = Curve(mesh_edges.NakedEdges)
pull_point = PullPoint(Point=point_on_curve, Geometry=construct_point_2, ClosestOnly=True)  # -> ClosestPoint, Distance
bounds_3 = Bounds(Numbers=pull_point.Distance)
remap_numbers_4 = RemapNumbers(Value=pull_point.Distance, Source=bounds_3, Target=Domain(0, 1))  # -> Mapped, Clipped
gradient = Gradient(
    LowerLimit=0,
    UpperLimit=1,
    Parameter=remap_numbers_4.Mapped,
    stops=[0: RGB(128, 0, 128), 0.499: RGB(255, 255, 0), 1: RGB(65, 105, 225)])
panel = Panel(gradient)
list_length = ListLength(List=gradient)
panel_2 = Panel(list_length)
random = Random(Range=Domain(0, 1), Number=list_length, Seed=2)
userkey = Text("color")
uservalue = Text(random)
panel_3 = Panel(random)
c_script = CSharpScript(geometry=curve_2, userKey=userkey, userValue=uservalue)  # -> out, geoWithUserString; inputs geometry: GeometryBase, userKey: String, userValue: String
# ---------- c_script: C# ----------
    geometry.SetUserString(userKey, userValue);
    geoWithUserString = geometry;
# ---------- end c_script ----------
curve_3 = Curve(flatten(c_script.geoWithUserString))
context_bake_2 = ContextBake(GeometryEdges=curve_3)
