# Grasshopper definition furniture.gh (Grasshopper 1.0.7)
# plug-ins: Weaverbird

number_slider = Slider(-22, range=-50..50.01)  # disabled
number_slider_2 = Slider(22, range=-50..51)  # disabled
number_slider_3 = Slider(22, range=-50..50.01)  # disabled
number_slider_4 = Slider(-22, range=-50..50.01)  # disabled
number_slider_5 = Slider(31.5, range=-50..50)  # disabled
number_slider_6 = Slider(32.5, range=-15..50)  # disabled
number_slider_7 = Slider(30, range=-50..50)
construct_point = ConstructPoint(XCoordinate=0, YCoordinate=0, ZCoordinate=0)
legs_length_start_point = GetInteger(Slider(-15, range=-50..50), AtLeast=1, AtMost=1, Maximum=2147483647, Minimum=-2147483648, TreeAccess=False)
legs_height_start_point = GetInteger(Slider(0, range=-50..30), AtLeast=1, AtMost=1, Maximum=2147483647, Minimum=-2147483648, TreeAccess=False)
legs_width_end_point = GetInteger(Slider(15, range=-15..30), AtLeast=1, AtMost=1, Maximum=2147483647, Minimum=-2147483648, TreeAccess=False)
legs_width_start_point = GetInteger(Slider(-15, range=-50..50), AtLeast=1, AtMost=1, Maximum=2147483647, Minimum=-2147483648, TreeAccess=False)
legs_length_end_point = GetInteger(Slider(15, range=-50..50), AtLeast=1, AtMost=1, Maximum=2147483647, Minimum=-2147483648, TreeAccess=False)
legs_height_end_point = GetInteger(number_slider_7, AtLeast=1, AtMost=1, Maximum=2147483647, Minimum=-2147483648, TreeAccess=False)
line_sdl = LineSDL(Start=construct_point, Direction=Vector(0, 0, 1), Length=number_slider_7)
construct_domain = ConstructDomain(DomainStart=legs_length_start_point, DomainEnd=legs_length_end_point)
construct_domain_2 = ConstructDomain(DomainStart=legs_width_start_point, DomainEnd=legs_width_end_point)
construct_domain_3 = ConstructDomain(DomainStart=legs_height_start_point, DomainEnd=legs_height_end_point)
construct_domain_4 = ConstructDomain(DomainStart=0, DomainEnd=1)  # disabled
construct_domain_5 = ConstructDomain(DomainStart=0, DomainEnd=1)  # disabled
construct_domain_6 = ConstructDomain(DomainStart=0, DomainEnd=1)  # disabled
rotation_angle = Slider(90, range=0..120)
domain_box = DomainBox(Base=PlaneXY(0, 0, 0), X=construct_domain_4, Y=construct_domain_5, Z=construct_domain_6)  # disabled
domain_box_2 = DomainBox(Base=PlaneXY(0, 0, 0), X=construct_domain_2, Y=construct_domain, Z=construct_domain_3)
rotation_angle_2 = GetNumber(rotation_angle, AtLeast=1, AtMost=1, Maximum=1.797693135e+308, Minimum=-1.797693135e+308, TreeAccess=False)
custom_preview = CustomPreview(
    Geometry=domain_box,
    Material={diffuse=RGB(221, 160, 221), emission=RGB(66, 48, 66), shine=0.5, specular=RGB(255, 255, 255), transparency=0})  # disabled
twist = Twist(Geometry=domain_box_2, Axis=line_sdl, Angle=degrees(rotation_angle_2), Infinite=False, Rigid=False)
mesh = Mesh(domain_box)  # disabled
deconstruct_brep = DeconstructBrep(Brep=twist)  # -> Faces, Edges, Vertices
ucount = GetInteger(Slider(2, range=0..10), AtLeast=1, AtMost=1, Maximum=2147483647, Minimum=-2147483648, TreeAccess=False)
vcount = GetInteger(Slider(2, range=0..10), AtLeast=1, AtMost=1, Maximum=2147483647, Minimum=-2147483648, TreeAccess=False)
mesh_surface = MeshSurface(Surface=deconstruct_brep.Faces, UCount=ucount, VCount=vcount, Overhang=True, Equalize=False)
weaverbird_s_picture_frame = WeaverbirdsPictureFrame(MeshPolylines=mesh_surface, Distance=5, InsetType=0)  # -> flatten(OutMesh)
thickness = Slider(2.2, range=0..10)
mesh_join = MeshJoin(Meshes=weaverbird_s_picture_frame)
thickness_2 = GetInteger(thickness, AtLeast=1, AtMost=1, Maximum=2147483647, Minimum=-2147483648, TreeAccess=False)
smoothness = Slider(3, range=1..3)
weaverbird_s_mesh_thicken = WeaverbirdsMeshThicken(MeshCurves=mesh_join, Distance=thickness_2, OffsetType=0)
smoothness_2 = GetInteger(smoothness, AtLeast=1, AtMost=1, Maximum=2147483647, Minimum=-2147483648, TreeAccess=False)
weaverbird_s_catmull_clark_subdivision = WeaverbirdsCatmullClarkSubdivision(MeshCurves=weaverbird_s_mesh_thicken, Level=smoothness_2, SmoothNakedEdges=1)
custom_preview_2 = CustomPreview(
    Geometry=weaverbird_s_catmull_clark_subdivision,
    Material={diffuse=RGB(221, 160, 221), emission=RGB(66, 48, 66), shine=0.5, specular=RGB(255, 255, 255), transparency=0})

# ---- group: RH_OUT: Furniture Leg
mesh_2 = Mesh(weaverbird_s_catmull_clark_subdivision)
